# Grasshopper definition MMgrasshopper.gh (Grasshopper 1.0.7)

file_path = FilePath("C:\Users\16598\workshop_final\dataset_2_yolo_spatial_elements_clean.csv")
read_file = ReadFile(File=file_path, PerLineParse=True)
cull_index = CullIndex(List=read_file, Indices=Slider(0, range=0..1), Wrap=True)
panel = Panel(cull_index)
text_split = TextSplit(Text=cull_index, Separators=",")
panel_2 = Panel(text_split)
list_item = ListItem(List=text_split, Index=Slider(7, range=-1.001..200), Wrap=True)
list_item_2 = ListItem(List=text_split, Index=Slider(4, range=-1.001..200), Wrap=True)
list_item_3 = ListItem(List=text_split, Index=Slider(6, range=-1.001..200), Wrap=True)
list_item_4 = ListItem(List=text_split, Index=Slider(5, range=-1.001..200), Wrap=True)
number_slider = Slider(100, range=-1.001..200)
list_item_5 = ListItem(List=text_split, Index=Slider(10, range=-1.001..200), Wrap=True)
expression = Expression(x=list_item_2, Expression="x")
expression_2 = Expression(x=list_item_3, Expression="x")
expression_3 = Expression(y=list_item, Expression="y")
expression_4 = Expression(y=list_item_4, Expression="y")
division = Division(A=list_item_5, B=Slider(20000, range=-1.001..50000))
number_slider_2 = Slider(1, range=-1.001..200)
division_2 = Division(A=expression_3, B=number_slider)
division_3 = Division(A=expression, B=number_slider)
division_4 = Division(A=expression_4, B=number_slider)
division_5 = Division(A=expression_2, B=number_slider)
maximum = Maximum(A=division, B=Slider(5, range=-1.001..200))
maximum_2 = Maximum(A=division_3, B=number_slider_2)
maximum_3 = Maximum(A=division_2, B=number_slider_2)
maximum_4 = Maximum(A=division_5, B=number_slider_2)
maximum_5 = Maximum(A=division_4, B=number_slider_2)
list_item_6 = ListItem(List=text_split, Index=Slider(1, range=-1.001..200), Wrap=True)
unit_z = UnitZ(Factor=1)
division_6 = Division(A=list_item_6, B=Slider(162, range=-1.001..200))
construct_point = ConstructPoint(XCoordinate=maximum_2, YCoordinate=maximum_5, ZCoordinate=maximum)
construct_point_2 = ConstructPoint(XCoordinate=maximum_4, YCoordinate=maximum_3, ZCoordinate=maximum)
multiplication = Multiplication(A=division_6, B=Slider(6.283, range=-1.001..200))
rectangle_2pt = Rectangle2Pt(Plane=PlaneXY(0, 0, 0), PointA=construct_point, PointB=construct_point_2, Radius=0)  # -> Rectangle, Length
amplitude = Amplitude(Vector=unit_z, Amplitude=maximum)
panel_3 = Panel(multiplication)
number_slider_3 = Slider(30, range=-1.001..200)
expression_5 = Expression(x=multiplication, Expression="cos(x)")
expression_6 = Expression(x=multiplication, Expression="sin(x)")
extrude = Extrude(Base=rectangle_2pt.Rectangle, Direction=amplitude)
multiplication_2 = Multiplication(A=expression_5, B=number_slider_3)
multiplication_3 = Multiplication(A=expression_6, B=number_slider_3)
construct_point_3 = ConstructPoint(XCoordinate=multiplication_2, YCoordinate=multiplication_3, ZCoordinate=Slider(0, range=-1.001..200))
move = Move(Geometry=extrude, Motion=construct_point_3)  # -> Geometry, Transform
xy_plane = XYPlane(Origin=Point(0, 0, 0))
rotate = Rotate(Geometry=move.Geometry, Angle=multiplication, Plane=xy_plane)  # -> Geometry, Transform
